% Simulink data dictionary CommonStorageClasses.sldd

CommonParam_1 = Simulink.Parameter([])
CommonParam_2 = Simulink.Parameter([])

DATA = Simulink.Bus()
  sub1_bus: Bus: sub1
  sub2_bus: Bus: sub2

sub1 = Simulink.Bus()
  sub1_a1: single
  sub1_a2: single

sub2 = Simulink.Bus()
  sub2_a1: single
  sub2_a2: single